# Grasshopper definition 00_voronoiExtrusions_original.gh (Grasshopper 1.0.7)

# ----
# Rectangle size
number_slider = Slider(37, range=0..100)

# ----
# Number of voronoi
number_slider_2 = Slider(330, range=0..1000)

rectangle = Rectangle(Plane=PlaneXY(0, 0, 0), XSize=number_slider, YSize=Slider(50, range=0..100), Radius=0)  # -> Rectangle, Length
pop2d = Populate2D(Region=rectangle.Rectangle, Count=number_slider_2, Seed=1)
lng = ListLength(List=pop2d)

# ----
# Max height
number_slider_3 = Slider(5.175, range=-5..10)

# ----
# Randomness
number_slider_4 = Slider(35, range=0..100)

# ----
# Top opening size
number_slider_5 = Slider(0.4, range=0..1)

voronoi = Voronoi(Points=pop2d, Boundary=rectangle.Rectangle, BruteForceOverride=False)
dom = ConstructDomain(DomainStart=0, DomainEnd=number_slider_3)
random = Random(Range=dom, Number=lng, Seed=number_slider_4)
scale = Scale(Geometry=voronoi, Center=pop2d, Factor=number_slider_5)  # -> Geometry, Transform
Z = UnitZ(Factor=random)  # -> flatten(UnitVector)
move = Move(Geometry=scale.Geometry, Motion=Z)  # -> Geometry, Transform
rulesrf = RuledSurface(CurveA=voronoi, CurveB=move.Geometry)
rulesrf_2 = RuledSurface(CurveA=move.Geometry, CurveB=scale.Geometry)

# ----
# Change color
swatch = ColourSwatch(SwatchColor=RGB(15, 216, 247))

preview = CustomPreview(Geometry=[rulesrf, rulesrf_2], Material=swatch)
