# Grasshopper definition 01_voronoiExtrusions_mod.gh (Grasshopper 1.0.7)
# plug-ins: Weaverbird, ShapeDiverForGrasshopper

# ----
# Max height
number_slider = Slider(5.17, range=-5..10)  # disabled

# ----
# Max height
number_slider_2 = Slider(5.17, range=-5..10)

# ----
# Rectangle size
number_slider_3 = Slider(20, range=0..100)  # disabled
number_slider_4 = Slider(20, range=0..100)  # disabled

# ----
# Top opening size
number_slider_5 = Slider(0.4, range=0..1)  # disabled

# ----
# Rectangle size
number_slider_6 = Slider(20, range=0..100)

# ----
# Top opening size
number_slider_7 = Slider(0.4, range=0..1)

# ----
# Number of voronoi
number_slider_8 = Slider(40, range=0..1000)  # disabled

# ----
# Number of voronoi
number_slider_9 = Slider(40, range=0..1000)

# ----
# Randomness
number_slider_10 = Slider(35, range=0..100)  # disabled

# ----
# Randomness
number_slider_11 = Slider(35, range=0..100)

sddp = ShapeDiverDocumentPayload({AbsoluteTolerance=0, AngleTolerance=0, DistanceDisplayPrecision=0, GltfVersion="Gltf2", GrasshopperVersion="1.0.0007", InputGroups="{}", OutputGroups="{}", RelativeTolerance=0, RhinoVersion="7.14.22010.17001", UnitSystem=0, VersionCreated="1.16.0.0", VersionSaved="1.16.0.0"})
seed = GetInteger(number_slider_10, AtLeast=1, AtMost=1, Maximum=2147483647, Minimum=-2147483648)  # disabled
seed_2 = GetInteger(number_slider_11, AtLeast=1, AtMost=1, Maximum=2147483647, Minimum=-2147483648)
opening = GetNumber(number_slider_5, AtLeast=1, AtMost=1, Maximum=1.797693135e+308, Minimum=-1.797693135e+308)  # disabled
opening_2 = GetNumber(number_slider_7, AtLeast=1, AtMost=1, Maximum=1.797693135e+308, Minimum=-1.797693135e+308)
number = GetInteger(number_slider_8, AtLeast=1, AtMost=1, Maximum=2147483647, Minimum=-2147483648)  # disabled
number_2 = GetInteger(number_slider_9, AtLeast=1, AtMost=1, Maximum=2147483647, Minimum=-2147483648)
width = GetInteger(number_slider_4, AtLeast=1, AtMost=1, Maximum=2147483647, Minimum=-2147483648)  # disabled
length = GetInteger(number_slider_3, AtLeast=1, AtMost=1, Maximum=2147483647, Minimum=-2147483648)  # disabled
height = GetNumber(number_slider, AtLeast=1, AtMost=1, Maximum=1.797693135e+308, Minimum=-1.797693135e+308)  # disabled
width_2 = GetInteger(Slider(20, range=0..100), AtLeast=1, AtMost=1, Maximum=2147483647, Minimum=-2147483648)
length_2 = GetInteger(number_slider_6, AtLeast=1, AtMost=1, Maximum=2147483647, Minimum=-2147483648)
height_2 = GetNumber(number_slider_2, AtLeast=1, AtMost=1, Maximum=1.797693135e+308, Minimum=-1.797693135e+308)
rectangle = Rectangle(Plane=PlaneXY(0, 0, 0), XSize=width, YSize=length, Radius=0)  # -> Rectangle, Length; disabled
rectangle_2 = Rectangle(Plane=PlaneXY(0, 0, 0), XSize=width_2, YSize=length_2, Radius=0)  # -> Rectangle, Length
pop2d = Populate2D(Region=rectangle.Rectangle, Count=number, Seed=1)  # disabled
pop2d_2 = Populate2D(Region=rectangle_2.Rectangle, Count=number_2, Seed=1)
lng = ListLength(List=pop2d)  # disabled
lng_2 = ListLength(List=pop2d_2)
voronoi = Voronoi(Points=pop2d, Boundary=rectangle.Rectangle, BruteForceOverride=False)  # disabled
voronoi_2 = Voronoi(Points=pop2d_2, Boundary=rectangle_2.Rectangle, BruteForceOverride=False)
dom = ConstructDomain(DomainStart=0, DomainEnd=height)  # disabled
dom_2 = ConstructDomain(DomainStart=0, DomainEnd=height_2)
random = Random(Range=dom, Number=lng, Seed=seed)  # disabled
random_2 = Random(Range=dom_2, Number=lng_2, Seed=seed_2)
scale = Scale(Geometry=voronoi, Center=pop2d, Factor=opening)  # -> Geometry, Transform; disabled
scale_2 = Scale(Geometry=voronoi_2, Center=pop2d_2, Factor=opening_2)  # -> Geometry, Transform
Z = UnitZ(Factor=random)  # -> flatten(UnitVector); disabled
Z_2 = UnitZ(Factor=random_2)  # -> flatten(UnitVector)
move = Move(Geometry=scale.Geometry, Motion=Z)  # -> Geometry, Transform; disabled
move_2 = Move(Geometry=scale_2.Geometry, Motion=Z_2)  # -> Geometry, Transform
rulesrf = RuledSurface(CurveA=voronoi, CurveB=move.Geometry)  # disabled
rulesrf_2 = RuledSurface(CurveA=voronoi_2, CurveB=move_2.Geometry)
rulesrf_3 = RuledSurface(CurveA=move.Geometry, CurveB=scale.Geometry)  # disabled
rulesrf_4 = RuledSurface(CurveA=move_2.Geometry, CurveB=scale_2.Geometry)
join = BrepJoin(Breps=[rulesrf, rulesrf_3])  # -> Breps, Closed; disabled
join_2 = BrepJoin()  # -> Breps, Closed
mesh = MeshBrep(
    Brep=join.Breps,
    Settings={GridMaxCount=0, GridMinCount=16, JaggedSeams=False, MaxEdgeLength=0, MinEdgeLength=0.0001, MinTolerance=0, Refine=True, RefineAngle=0, RelativeTolerance=0.65, SimplePlanes=True, Tolerance=0})  # disabled
mesh_2 = MeshBrep(
    Brep=[join_2.Breps, rulesrf_2, rulesrf_4],
    Settings={GridMaxCount=0, GridMinCount=16, JaggedSeams=False, MaxEdgeLength=0, MinEdgeLength=0.0001, MinTolerance=0, Refine=True, RefineAngle=0, RelativeTolerance=0.65, SimplePlanes=True, Tolerance=0})
wbjoin = WeaverbirdsJoinMeshesAndWeld(Mesh=mesh, Weld=False)  # disabled
wbjoin_2 = WeaverbirdsJoinMeshesAndWeld(Mesh=mesh_2, Weld=False)
wbcatmullclark = WeaverbirdsCatmullClarkSubdivision(MeshCurves=wbjoin, Level=1, SmoothNakedEdges=1)  # disabled
wbcatmullclark_2 = WeaverbirdsCatmullClarkSubdivision(MeshCurves=mesh_2, Level="1", SmoothNakedEdges=1)
context_bake = ContextBake(Geometry=wbcatmullclark)  # disabled
preview = CustomPreview(
    Geometry=wbcatmullclark_2,
    Material={diffuse=RGB(221, 160, 221), emission=RGB(66, 48, 66), shine=0.5, specular=RGB(255, 255, 255), transparency=0})
context_bake_2 = ContextBake(Geometry=wbcatmullclark_2)
