# Grasshopper definition 03_voronoiExtrusions_hopsImplementation.gh (Grasshopper 1.0.7)
# plug-ins: Hops, ShapeDiverForGrasshopper

sddp = ShapeDiverDocumentPayload({AbsoluteTolerance=0, AngleTolerance=0, DistanceDisplayPrecision=0, GltfVersion="Gltf2", GrasshopperVersion="1.0.0007", InputGroups="{}", OutputGroups="{}", RelativeTolerance=0, RhinoVersion="7.14.22010.17001", UnitSystem=0, VersionCreated="1.16.0.0", VersionSaved="1.16.0.0"})
panel = Panel("https://github.com/luisFPA/bimsc24-datamgmt-session01/raw/main/Session01/02_voronoiExtrusions_hops.gh")
panel_2 = Panel("C:\Users\l03063058\Desktop\_MaCAD\BIMSC\dataMngmnt\bimsc24-datamgmt-session01\Session01\02_voronoiExtrusions_hops.gh")
hops = Hops(
    _Path=panel,
    Width=Slider(20, range=0..100),
    Length=Slider(20, range=0..100),
    Number=Slider(50, range=0..1000),
    Opening=Slider(0.4, range=0..1),
    Height=Slider(5, range=-5..10),
    Seed=Slider(35, range=0..100),
    CacheResultsInMemory=True,
    CacheSolveResults=True,
    RemoteDefinitionLocation="https://github.com/luisFPA/bimsc24-datamgmt-session01/raw/main/Session01/02_voronoiExtrusions_hops.gh",
    RemoteSolveVersion=(0, 1, 0),
    ShowInput_Enabled=False,
    ShowInput_Path=True,
    SynchronousSolve=False)  # -> SimpleBrep, Mesh
mesh = Mesh(hops.Mesh)
brep = Brep(hops.SimpleBrep)
preview = CustomPreview(Geometry=mesh, Material=ColourSwatch(SwatchColor=RGB(62, 216, 131)))
