# Grasshopper definition Spikey_hopsImplemented.gh (Grasshopper 1.0.7)
# plug-ins: Hops

# WITH FILE NAME (right-click and check path)
number_slider = Slider(4.15, range=0..10)  # disabled
number_slider_2 = Slider(13, range=0..100)  # disabled
# FROM SERVER AT GITHUB
# 
# Can have multiple inputs that are solve simultaneouly
number_slider_3 = Slider(7.55, range=0..10)  # disabled
# https://github.com/iaac-macad/bimsc24-datamgmt-session01/raw/main/Session01/Spikey.gh
# FROM SERVER AT GITHUB
number_slider_4 = Slider(7.53, range=0..10)
# BY DOUBLE CLICKING COMPONENT
number_slider_5 = Slider(4.15, range=0..10)  # disabled
number_slider_6 = Slider(7.55, range=0..10)  # disabled
panel = Panel("https://github.com/iaac-macad/bimsc24-datamgmt-session01/raw/main/Session01/Spikey.gh")
number_slider_7 = Slider(1000, range=0..1000)
number_slider_8 = Slider(8, range=0..10)  # disabled
number_slider_9 = Slider(7.55, range=0..10)
number_slider_10 = Slider(45, range=0..100)
panel_2 = Panel("C:\Users\l03063058\Desktop\_MaCAD\BIMSC\repository\bimsc24-datamgmt-session01\Session01\Spikey_hops.gh")  # disabled
hops = Hops(
    Radius=number_slider_5,
    Count=number_slider_8,
    Length=number_slider_6,
    CacheResultsInMemory=True,
    CacheSolveResults=True,
    RemoteDefinitionLocation="C:\Users\l03063058\Desktop\_MaCAD\BIMSC\repository\bimsc24-datamgmt-session01\Session01\Spikey_hops.gh",
    RemoteSolveVersion=(0, 1, 0),
    ShowInput_Enabled=False,
    ShowInput_Path=False,
    SynchronousSolve=True)  # -> Geometry, SubD; disabled
hops_2 = Hops(
    _Path=panel,
    Radius=Slider(7.53, range=0..10),
    Count=[Slider(1000, range=0..1000), Slider(45, range=0..100)],
    Length=Slider(7.55, range=0..10),
    CacheResultsInMemory=True,
    CacheSolveResults=True,
    RemoteDefinitionLocation="https://github.com/iaac-macad/bimsc24-datamgmt-session01/raw/main/Session01/Spikey.gh",
    RemoteSolveVersion=(0, 1, 0),
    ShowInput_Enabled=False,
    ShowInput_Path=True,
    SynchronousSolve=False)
hops_3 = Hops(
    _Path=panel_2,
    Radius=number_slider,
    Count=number_slider_2,
    Length=number_slider_3,
    CacheResultsInMemory=True,
    CacheSolveResults=True,
    RemoteDefinitionLocation="C:\Users\l03063058\Desktop\_MaCAD\BIMSC\repository\bimsc24-datamgmt-session01\Session01\Spikey_hops.gh",
    RemoteSolveVersion=(0, 1, 0),
    ShowInput_Enabled=False,
    ShowInput_Path=True,
    SynchronousSolve=True)  # -> Geometry, SubD; disabled
data = Data(hops.SubD)  # disabled
panel_3 = Panel(hops_2)
